# Grasshopper definition 011123_PrintTestFor140cmB_V2.ghx (Grasshopper 1.0.7)
# plug-ins: Pufferfish

looprad = Slider(0, range=0..0.01)
looprad_2 = Slider(0.0016, range=0..0.01)
looplen = Slider(8.43, range=0..10)
_6ptcake = Curve([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])
scalecheck = Geometry([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])
_6ptcakebase = Curve([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])
ghpython_script = GhPythonScript(loopStart=looprad, loopRad=looprad_2, loopLen=looplen)  # -> spiral
# ---------- ghpython_script: Python ----------
import rhinoscriptsyntax as rs
import math

a = loopStart
b= loopRad
len = loopLen
theta_max = len * math.pi
theta = 0
points = []

while theta < theta_max:
    x = (a + b * theta) * math.cos(theta)
    y = (a + b * theta) * math.sin(theta)
    points.append((x, y, 0))
    theta += 0.1
polyline = rs.AddPolyline(points)


spiral = polyline
# ---------- end ghpython_script ----------

curveswithguides = Curve([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])  # disabled
printcurves_cake = Curve([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])

# ---- group: SpiralDistCheck
X = UnitX(Factor=Slider(0.07, range=0..0.1))
pt = ConstructPoint(XCoordinate=0, YCoordinate=0, ZCoordinate=0)
move = Move(Geometry=pt, Motion=X)  # -> Geometry, Transform
ln = Line(StartPoint=pt, EndPoint=move.Geometry)
ccx = CurveCurve(CurveA=ghpython_script, CurveB=ln)  # -> Points, ParamsA, ParamsB
shatter = Shatter(Curve=ln, Parameters=ccx.ParamsB)
midpt = CurveMiddle(Curve=shatter)
len = Length(Curve=shatter)
tag = TextTag(Location=midpt, Text=len)
panel = Panel(len)

# ----
panel_2 = Panel(ghpython_script)
len_2 = Length(Curve=ghpython_script)
len_3 = Length(Curve=printcurves_cake)

# ---- group: SpiralLen
panel_3 = Panel(len_2)

# ----
panel_4 = Panel(len_3)
ma = MassAddition(Input=len_3)  # -> Result, PartialResults
X_2 = UnitX(Factor=Slider(0.2, range=0..0.5))
panel_5 = Panel(ma.Result)
layercount = Slider(5, range=1..10)
zheight = Slider(0.01, range=0..0.015)
move_2 = Move(Geometry=ghpython_script, Motion=X_2)  # -> Geometry, Transform
division = Division(A=panel_5, B=layercount)
series = Series(Start=0, Step=1, Count=layercount)
multiplication = Multiplication(A=series, B=zheight)
Z = UnitZ(Factor=multiplication)
_1_spirallenght = Panel(panel_3)
dividedlengofcakeprint = Panel(division)
panel_6 = Panel(series)
move_3 = Move(Geometry=move_2.Geometry, Motion=Z)  # -> simplify(Geometry), Transform
panel_7 = Panel(move_3.Geometry)

# ---- group: WIP_SpiralPrintViz
arbitrarysection = Curve(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)  # disabled
area = Area(Geometry=arbitrarysection)  # -> Area, Centroid; disabled
X_3 = UnitX(Factor=1)  # disabled
panel_8 = Panel("90")  # disabled
rot3d = Rotate3D(Geometry=arbitrarysection, Angle=degrees(panel_8), Center=area.Centroid, Axis=X_3)  # -> Geometry, Transform; disabled
number_slider = Slider(1, range=0..1)  # disabled
swp1 = Sweep1(Rail=move_3.Geometry, Sections=rot3d.Geometry, Miter=1)  # disabled
end = EndPoints(Curve=move_3.Geometry)  # -> Start, End; disabled
curvepoint = PointOnCurve(move_3.Geometry, parameter=0)  # disabled
len_4 = Length(Curve=move_3.Geometry)  # disabled
pt_2 = Point(end.End)  # disabled
multiplication_2 = Multiplication(A=number_slider, B=len_4)  # disabled
eval = EvaluateCurve(Curve=simplify(move_3.Geometry), Parameter=curvepoint)  # -> Point, Tangent, Angle; disabled
move2pt = MoveToPoint(Geometry=rot3d.Geometry, PointA=area.Centroid, PointB=pt_2)  # -> Moved, Vector, Transform; disabled
panel_9 = Panel(move_3.Geometry)  # disabled
pt_3 = Point(eval.Point)  # disabled
panel_10 = Panel("-1")  # disabled
Y = UnitY(Factor=panel_10)  # disabled
rotate = RotateDirection(Geometry=move2pt.Moved, Center=Point(0, 0, 0), From=Y, To=Vector(0, 1, 0))  # -> Geometry, Transform; disabled
vrot = Rotate()  # disabled

# ----
printcurves_cake_2 = Curve(printcurves_cake)
printcurves_spiral = Curve(move_3.Geometry)
